# Grasshopper definition Demo.gh (Grasshopper 1.0.7)
# plug-ins: RodSteward

# ---- group: From Mesh Demo
number_slider = Slider(11.9, range=3..20)
button = Button()
msphereex = MeshSphereEx(Base=PlaneXY(0, 0, 0), Radius="1000", Count=Slider(3, range=0..10))
rsmesh2graph = Mesh2Graph(Mesh=msphereex)  # -> Edges, Vertices
rsgenerator = Generator(
    Edges=rsmesh2graph.Edges,
    Vertices=rsmesh2graph.Vertices,
    Sides=Slider(3, range=3..10),
    Radius=number_slider,
    JointThickness=Slider(3.2, range=0..10),
    JointLength=Slider(36, range=0..100),
    Tolerance=Slider(0.02, range=0..3))  # -> Joints, Rods, RodCurves
geo = Geometry(rsgenerator.Joints)
len = Length(Curve=rsgenerator.RodCurves)
rsoutputjointstl = OutputJointSTL(Joint=geo, Directory="C:\RS-GH_Demo_1", WriteTrigger=button)
rsoutputrodcutsvg = OutputRodCutSVG(
    RodCurves=rsgenerator.RodCurves,
    StockLength=Slider(1000, range=0..1000),
    Radius=number_slider,
    Directory="C:\RS-GH_Demo_1",
    WriteTrigger=button)  # -> Output, CuttingPlan
panel = Panel(rsoutputjointstl)
panel_2 = Panel(rsoutputrodcutsvg.Output)
panel_3 = Panel(rsoutputrodcutsvg.CuttingPlan)
panel_4 = Panel(len)

# ---- group: From Lines Demo
number_slider_2 = Slider(10.6, range=3..20)
button_2 = Button()
scale = Scale(Geometry=msphereex, Center=Point(0, 0, 0), Factor="0.5")  # -> Geometry, Transform
medges = MeshEdges(Mesh=scale.Geometry)  # -> NakedEdges, InteriorEdges, NonManifoldEdges
rslines2graph = Lines2Graph(Lines=medges.InteriorEdges, Tolerance="10")  # -> Edges, Vertices
rsgenerator_2 = Generator(
    Edges=rslines2graph.Edges,
    Vertices=rslines2graph.Vertices,
    Sides=Slider(3, range=3..10),
    Radius=number_slider_2,
    JointThickness=Slider(3.2, range=0..10),
    JointLength=Slider(36, range=0..100),
    Tolerance=Slider(0.02, range=0..3))  # -> Joints, Rods, RodCurves
geo_2 = Geometry(rsgenerator_2.Joints)
len_2 = Length(Curve=rsgenerator_2.RodCurves)
rsoutputjointstl_2 = OutputJointSTL(Joint=geo_2, Directory="C:\RS-GH_Demo_2", WriteTrigger=button_2)
rsoutputrodcutsvg_2 = OutputRodCutSVG(
    RodCurves=rsgenerator_2.RodCurves,
    StockLength=Slider(1000, range=0..1000),
    Radius=number_slider_2,
    Directory="C:\RS-GH_Demo_2",
    WriteTrigger=button_2)  # -> Output, CuttingPlan
panel_5 = Panel(rsoutputjointstl_2)
panel_6 = Panel(rsoutputrodcutsvg_2.Output)
panel_7 = Panel(rsoutputrodcutsvg_2.CuttingPlan)
panel_8 = Panel(len_2)
